% Simulink data dictionary pcssp_KCURR.sldd

KCURR_P_tmpl = Simulink.Parameter(repmat(1, 1, 11), StorageClass="ExportedGlobal")
KCURR_I_tmpl = Simulink.Parameter(repmat(0, 1, 11), StorageClass="ExportedGlobal")
KCURR_D_tmpl = Simulink.Parameter(repmat(1, 1, 11), StorageClass="ExportedGlobal")

KCURR_KdRef_tmpl = Simulink.Parameter([0.759 0.2246 0.0636 0.0072 0.0037 0.1365 0.0431 0.0468 0.0267 0.0148 0.0107
 0.2246 0.7596 0.2727 0.0162 0.0072 0.06 0.0354 0.0492 0.0337 0.0216 0.0174
 0.0636 0.2727 1.9777 0.2727 0.0636 0.0413 0.043 0.0877 0.0847 0.0783 0.088
 0.0072 0.0162 0.2727 0.7596 0.2246 0.0079 0.0117 0.0332 0.0446 0.0646 0.1203
 0.0037 0.0072 0.0636 0.2246 0.759 0.0048 0.008 0.0259 0.0406 0.0795 0.2496
 0.1365 0.06 0.0413 0.0079 0.0048 0.7041 0.1132 0.1008 0.0492 0.0243 0.016
 0.0431 0.0354 0.043 0.0117 0.008 0.1132 0.4716 0.2393 0.1027 0.0471 0.0293
 0.0468 0.0492 0.0877 0.0332 0.0259 0.1008 0.2393 1.8557 0.4553 0.1838 0.1064
 0.0267 0.0337 0.0847 0.0446 0.0406 0.0492 0.1027 0.4553 1.5601 0.3607 0.1891
 0.0148 0.0216 0.0783 0.0646 0.0795 0.0243 0.0471 0.1838 0.3607 1.5558 0.491
 0.0107 0.0174 0.088 0.1203 0.2496 0.016 0.0293 0.1064 0.1891 0.491 2.3832], StorageClass="ExportedGlobal")

KCURR_Ke_tmpl = Simulink.Parameter([7.5897 2.2463 0.636 0.0716 0.0375 1.365 0.4311 0.4682 0.2669 0.1481 0.1069
 2.2463 7.5965 2.7271 0.162 0.0716 0.5997 0.3544 0.4922 0.3368 0.2156 0.1735
 0.636 2.7271 19.7766 2.7271 0.636 0.4134 0.4295 0.8765 0.8473 0.7833 0.8801
 0.0716 0.162 2.7271 7.5964 2.2462 0.079 0.1174 0.332 0.446 0.6465 1.2032
 0.0375 0.0716 0.636 2.2462 7.5896 0.0483 0.0802 0.259 0.4057 0.795 2.4959
 1.365 0.5997 0.4134 0.079 0.0483 7.0413 1.1325 1.0079 0.4918 0.2431 0.1598
 0.4311 0.3544 0.4295 0.1174 0.0802 1.1325 4.7161 2.3927 1.0274 0.471 0.2927
 0.4682 0.4922 0.8765 0.332 0.259 1.0079 2.3927 18.5566 4.5527 1.8379 1.0635
 0.2669 0.3368 0.8473 0.446 0.4057 0.4918 1.0274 4.5527 15.6013 3.607 1.8907
 0.1481 0.2156 0.7833 0.6465 0.795 0.2431 0.471 1.8379 3.607 15.5583 4.9103
 0.1069 0.1735 0.8801 1.2032 2.4959 0.1598 0.2927 1.0635 1.8907 4.9103 23.8321], StorageClass="ExportedGlobal")

KCURR_Ky_tmpl = Simulink.Parameter(repmat(0, 11, 11), StorageClass="ExportedGlobal")
KCURR_N_tmpl = Simulink.Parameter(repmat(100, 1, 11), StorageClass="ExportedGlobal")
KCURR_Nd_tmpl = Simulink.Parameter(100, StorageClass="ExportedGlobal")
KCURR_Vlow_tmpl = Simulink.Parameter([1050 1050 2100 1050 1050 1050 3150 3150 3150 3150 1050], StorageClass="ExportedGlobal")
KCURR_Vup_tmpl = Simulink.Parameter([1050 1050 2100 1050 1050 1050 3150 3150 3150 3150 1050], StorageClass="ExportedGlobal")
KCURR_NegCurSlewRate_tmpl = Simulink.Parameter([-1383.4 -1382.3 -1061.8 -1382.3 -1383.4 -1491.3 -6679.4 -1697.5 -2019.1 -2024.7 -440.6], StorageClass="ExportedGlobal")
KCURR_PosCurSlewRate_tmpl = Simulink.Parameter([1383.4 1382.3 1061.8 1382.3 1383.4 1491.3 6679.4 1697.5 2019.1 2024.7 440.6], StorageClass="ExportedGlobal")

pcssp_KCURR_fp = struct(
  timing=struct(t_start=0, t_stop=10, dt=0.001),
  PosCurSlewRate=[1383.4 1382.3 1061.8 1382.3 1383.4 1491.3 6679.4 1697.5 2019.1 2024.7 440.6],
  NegCurSlewRate=[-1383.4 -1382.3 -1061.8 -1382.3 -1383.4 -1491.3 -6679.4 -1697.5 -2019.1 -2024.7 -440.6])