% Simulink data dictionary pcssp_KMAG.sldd

pcssp_KMAG_fp = struct(timing=struct(t_start=0, t_stop=10, dt=0.002))

pcssp_KMAG_extFF = Simulink.Bus()
  extFF: double[11]

pcssp_KMAG_y = Simulink.Bus()
  y: double[10]

pcssp_KMAG_ref = Simulink.Bus()
  ref: double[10]

pcssp_KMAG_out = Simulink.Bus()
  u: double[11], Unit="A"
  IC_FB: double[11], Unit="A"
  PIDinternalSignal: double[30]
  errorSignal: double[10 1], Unit="T"

pcssp_KMAG_tp_tmpl = Simulink.Parameter(struct(
  Ke=[-28670 34910 -109600 -61980 15820 1380 -79930 5000 -33750 107970
   -4300 49190 266010 -320680 -89150 -14470 213760 -294110 141230 -69990
   -8230 89070 -109150 128070 -98530 23030 -80450 198760 -447440 298310
   60280 -203200 325320 92860 19480 -28160 246550 -127230 418190 -542920
   27220 -53430 89760 38240 33040 -9510 58170 -41770 149520 -165290
   -64820 62380 -448030 96250 75680 20610 -335880 248860 -252220 351720
   -79530 20450 -526450 190300 68090 33330 -374430 359300 -304180 362660
   -14110 -195650 264260 12300 -144100 28740 302600 -17230 198910 -331740
   31190 108560 160080 -115050 -57970 36320 136890 -80820 -59420 128610
   16680 216660 -299770 45470 127150 30260 -279790 136410 -267230 459950
   35820 72090 -113700 76140 123830 5400 -131940 47420 -1940 106630],
  P=repmat(1, 10, 1),
  I=repmat(0, 10, 1),
  D=repmat(0, 10, 1),
  N=repmat(100, 10, 1)), StorageClass="ExportedGlobal")

pcssp_KMAG_Ke_tmpl = Simulink.Parameter([-28670 34910 -109600 -61980 15820 1380 -79930 5000 -33750 107970
 -4300 49190 266010 -320680 -89150 -14470 213760 -294110 141230 -69990
 -8230 89070 -109150 128070 -98530 23030 -80450 198760 -447440 298310
 60280 -203200 325320 92860 19480 -28160 246550 -127230 418190 -542920
 27220 -53430 89760 38240 33040 -9510 58170 -41770 149520 -165290
 -64820 62380 -448030 96250 75680 20610 -335880 248860 -252220 351720
 -79530 20450 -526450 190300 68090 33330 -374430 359300 -304180 362660
 -14110 -195650 264260 12300 -144100 28740 302600 -17230 198910 -331740
 31190 108560 160080 -115050 -57970 36320 136890 -80820 -59420 128610
 16680 216660 -299770 45470 127150 30260 -279790 136410 -267230 459950
 35820 72090 -113700 76140 123830 5400 -131940 47420 -1940 106630], StorageClass="ExportedGlobal")

pcssp_KMAG_P_tmpl = Simulink.Parameter(repmat(1, 10, 1), StorageClass="ExportedGlobal")
pcssp_KMAG_I_tmpl = Simulink.Parameter(repmat(0, 10, 1), StorageClass="ExportedGlobal")
pcssp_KMAG_D_tmpl = Simulink.Parameter(repmat(1, 10, 1), StorageClass="ExportedGlobal")
pcssp_KMAG_N_tmpl = Simulink.Parameter(repmat(100, 10, 1), StorageClass="ExportedGlobal")
size = struct(extFF=[11 1], Ref=[10 1], y=[10 1], enable=1)