% Simulink data dictionary pcssp_PID.sldd
% references pcssp_PID.sldd

pcssp_PID_fp = struct(timing=struct(t_start=0, t_stop=10, dt=0.001))
pcssp_PID_tp_tmpl = Simulink.Parameter(struct(enable=true, P=[50 0 0], I=[3 0 0], D=[0 0 0]), StorageClass="ExportedGlobal")

pcssp_PID_inBus = Simulink.Bus()
  error: double[3]

pcssp_PID_outBus = Simulink.Bus()
  controlCmd: double[3]

algo_PID_init1 = Simulink.Bus()
  clipgain1: single
  tstart1: single
  tstop1: single
  enable1: boolean