% Simulink data dictionary pcssp_TF.sldd
% references pcssp_TF.sldd

pcssp_TF_tp_tmpl = Simulink.Parameter(struct(num=0.0001, den=[1 -0.9999]), StorageClass="ExportedGlobal")

pcssp_TF_inBus = Simulink.Bus()
  controlCmd: double

pcssp_TF_outBus = Simulink.Bus()
  yMeas: double

pcssp_TF_fp = struct(timing=struct(t_start=0, t_stop=10, dt=0.001), z_delay=1)

algo_TF_init1 = Simulink.Bus()
  clipgain1: single
  tstart1: single
  tstop1: single
  enable1: boolean