% Simulink data dictionary topmain.sldd
% references wrapper_PID.sldd
% references wrapper_TF.sldd
% references RTF_01.sldd

RFMOUTextbus = Simulink.Bus()  % RFM bus from external nodes (MANTIS)
  MANTISdetach: single  % MANTIS detachment indicator
  MANTIScheck: single  % MANTIS checking signal

RFMINbus = Simulink.Bus()  % RFM input bus for all nodes
  Node01_RFM: Bus: RFMOUT01bus  % Node 01 RFM output
  Externals_RFM: Bus: RFMOUTextbus  % Bus for data from external nodes writing to RFM

SCDvaralgo = struct(algo0101=1000, algo0102=1000)
SCDnode01params = struct(active=true, name="NODE01", timing=struct(t_start=0, t_stop=10, dt=0.001, thperiod=[0.001 0.001]))