% Simulink data dictionary pcssp_PowerSupplies.sldd

pcssp_PS_CSPF_volt_cmd = Simulink.Bus()
  CSPF_volt_cmd: double[11]

pcssp_PS_VS1_volt_cmd = Simulink.Bus()
  VS1_volt_cmd: double

pcssp_PS_VS3_volt_cmd = Simulink.Bus()
  VS3_volt_cmd: double

pcssp_PS_CSPF_curr_meas = Simulink.Bus()
  CSPF_curr_meas: double[11]

pcssp_PS_VCSPF = Simulink.Bus()
  VCSPF: double[11]

pcssp_PS_VS1 = Simulink.Bus()
  VS1: double

pcssp_PS_VS3 = Simulink.Bus()
  VS3: double

PowerSupplies_fp = struct(
  timing=struct(t_start=0, t_stop=10, dt=0.001),
  nMConverters=[2; 2; 4; 2; 2; 2; 3; 3; 3; 3; 2],
  VMCpositiveSR=[140000; 140000; 280000; 140000; 140000; 140000; 210000; 210000; 210000; 210000; 140000],
  VMCnegativeSR=[-140000; -140000; -280000; -140000; -140000; -140000; -210000; -210000; -210000; -210000; -140000],
  VMCtaud=repmat(0.003, 1, 11),
  nVS1Converters=6,
  VS1positiveSR=420000,
  VS1negativeSR=-420000,
  VS1taud=0.003,
  VS3filterNum=1,
  VS3filterDen=[0.0075 1],
  VS3taud=0.0025)

PowerSupplies_tp_tmpl = Simulink.Parameter(struct(currentLim=[0 55000 200000], voltageLim=[1200 1050 1050], VS3Vup=2300, VS3Vlow=-2300), StorageClass="ExportedGlobal")